# Dynamo graph AUTOMATE-NUMBERING-PARKING-ALONG-SPLINE(CUT-THROUGH).dyn (Dynamo 2.6.1.8786)
# packages: spring nodes 204.1.0

# group: GET ALL ELEMENTS
categories = Categories("OST_Parking")
all_elements_of_category = ElementsOfCategory(Category=categories)

# group: GET CURVE GEOMETRY
select_spline = DSModelElementSelection()  # 1 picked in the model; graph input
geometry = Element.Geometry(element=select_spline)
XY = Plane.XY()
pullOntoPlane = Curve.PullOntoPlane(curve=geometry, plane=XY)

# group: GET PARKING GEOMETRY
curves = Element.Curves(element=all_elements_of_category)
isEmpty = List.IsEmpty(list=curves@L2)
filterByBoolMask = List.FilterByBoolMask(list=curves, mask=isEmpty)
flatten = List.Flatten(list=filterByBoolMask.out)

# group: GEOMETRY INTERSECT
intersect = Geometry.Intersect(geometry=pullOntoPlane, other=filterByBoolMask.out, lacing=Longest)
isEmpty_2 = List.IsEmpty(list=intersect@L2, lacing=Longest)

# group: FILTER EMPTY LIST
filterByBoolMask_2 = List.FilterByBoolMask(list=intersect@L3, mask=isEmpty_2)

# group: GET THE FIRST INTERSECT POINTS
flatten_2 = List.Flatten(list=filterByBoolMask_2.out)
ꟿ_list_getevenodd = Custom[ꟿ List.GetEvenOdd](list=flatten_2)  # package spring nodes; Gets the even and odd indices from the list.
parameterAtPoint = Curve.ParameterAtPoint(curve=pullOntoPlane, point=ꟿ_list_getevenodd.even, lacing=Longest)

# group: SORT ROOMS BASED ON POINT LIST
sortByKey = List.SortByKey(list=all_elements_of_category, keys=parameterAtPoint)

# group: START ROOM LABEL AT A NUMBER
starting_number = DoubleSlider(15, range=0..100 step 1)  # graph input
count = List.Count(list=sortByKey.sorted_list)
code_block = CodeBlock(N=starting_number, C=count) { N..N+(C-1)..1; }

# group: ADD PREFIX +SURFIX TO NUMBER
PREFIX = StringInput("R.")  # graph input
string_from_object = FromObject(obj=code_block)
code_block_2 = CodeBlock { "."; }
split = String.Split(str=string_from_object, separator0=code_block_2)
code_block_3 = CodeBlock { 0; }
getItemAtIndex = List.GetItemAtIndex(list=split@L2, index=code_block_3)
add = PREFIX + getItemAtIndex

# group: WRITE DATA TO PARAMETER
parameter_name = StringInput("Mark")  # graph input
setParameterByName = Element.SetParameterByName(element=sortByKey.sorted_list, parameterName=parameter_name, value=add, lacing=Longest)
