# Dynamo graph AUTOMATE-NUMBERING-PARKING-ALONG-SPLINE.dyn (Dynamo 2.6.1.8786)

# group: GET PARKING LOCATION
select_parking_lots = DSModelElementsSelection()  # 24 picked in the model; graph input
getLocation = Element.GetLocation(element=select_parking_lots)

# group: GET CURVE GEOMETRY
select_spline = DSModelElementSelection()  # 1 picked in the model; graph input
geometry = Element.Geometry(element=select_spline)
XY = Plane.XY()
pullOntoPlane = Curve.PullOntoPlane(curve=geometry, plane=XY)

# group: GET X Y COORDINATES
code_block = CodeBlock(Loc=getLocation) { Point.X(Loc); Point.Y(Loc); }
byCoordinates = Point.ByCoordinates(x=code_block.out0, y=code_block.out1)

# group: CREATE CLOSEST POINTS ON CURVE
closestPointTo = Geometry.ClosestPointTo(geometry=pullOntoPlane, other=byCoordinates, lacing=Longest)
parameterAtPoint = Curve.ParameterAtPoint(curve=pullOntoPlane, point=closestPointTo, lacing=Longest)

# group: SORT PARKING BASED ON POINT LIST
sortByKey = List.SortByKey(list=select_parking_lots, keys=parameterAtPoint)

# group: START ROOM LABEL AT A NUMBER
starting_number = DoubleSlider(20, range=0..100 step 1)  # graph input
count = List.Count(list=sortByKey.sorted_list)
code_block_2 = CodeBlock(N=starting_number, C=count) { N..N+(C-1)..1; }

# group: ADD PREFIX +SURFIX TO NUMBER
PREFIX = StringInput("L.")  # graph input
string_from_object = FromObject(obj=code_block_2)
code_block_3 = CodeBlock { "."; }
split = String.Split(str=string_from_object, separator0=code_block_3)
code_block_4 = CodeBlock { 0; }
getItemAtIndex = List.GetItemAtIndex(list=split@L2, index=code_block_4)
add = PREFIX + getItemAtIndex

# group: WRITE DATA TO PARAMETER
parameter_name = StringInput("Mark")  # graph input
setParameterByName = Element.SetParameterByName(element=sortByKey.sorted_list, parameterName=parameter_name, value=add, lacing=Longest)
