# Dynamo graph AUTOMATE-NUMBERING-ROOMS-ALONG-SPLINE.dyn (Dynamo 2.6.1.8786)

# group: GET ALL ELEMENTS
categories = Categories("OST_Rooms")
all_elements_of_category = ElementsOfCategory(Category=categories)

# group: GET CURVE GEOMETRY
select_spline = DSModelElementSelection()  # 1 picked in the model; graph input
geometry = Element.Geometry(element=select_spline)
XY = Plane.XY()
pullOntoPlane = Curve.PullOntoPlane(curve=geometry, plane=XY)

# group: GET ROOM GEOMETRY
finishBoundary = Room.FinishBoundary(room=all_elements_of_category)
byJoinedCurves = PolyCurve.ByJoinedCurves(curves=finishBoundary)
pullOntoPlane_2 = Curve.PullOntoPlane(curve=byJoinedCurves, plane=XY)
flatten = List.Flatten(list=pullOntoPlane_2)

# group: GEOMETRY INTERSECT
intersect = Geometry.Intersect(geometry=pullOntoPlane, other=flatten, lacing=CrossProduct)
isEmpty = List.IsEmpty(list=intersect@L2, lacing=Longest)

# group: FILTER EMPTY LIST
filterByBoolMask = List.FilterByBoolMask(list=all_elements_of_category, mask=isEmpty)
filterByBoolMask_2 = List.FilterByBoolMask(list=intersect@L3, mask=isEmpty)

# group: GET THE FIRST INTERSECT POINT
code_block = CodeBlock { 0; }
getItemAtIndex = List.GetItemAtIndex(list=filterByBoolMask_2.out@L2, index=code_block)
parameterAtPoint = Curve.ParameterAtPoint(curve=pullOntoPlane, point=getItemAtIndex, lacing=Longest)

# group: SORT ROOMS BASED ON POINT LIST
sortByKey = List.SortByKey(list=filterByBoolMask.out, keys=parameterAtPoint)

PREFIX = StringInput("R.")  # graph input

# group: START ROOM LABEL AT A NUMBER
starting_number = DoubleSlider(20, range=0..100 step 1)  # graph input
count = List.Count(list=sortByKey.sorted_list)
code_block_2 = CodeBlock(N=starting_number, C=count) { N..N+(C-1)..1; }

string_from_object = FromObject(obj=code_block_2)
code_block_3 = CodeBlock { "."; }
split = String.Split(str=string_from_object, separator0=code_block_3)
code_block_4 = CodeBlock { 0; }
getItemAtIndex_2 = List.GetItemAtIndex(list=split@L2, index=code_block_4)
add = PREFIX + getItemAtIndex_2

# group: WRITE DATA TO PARAMETER
parameter_name = StringInput("Number")  # graph input
setParameterByName = Element.SetParameterByName(element=sortByKey.sorted_list, parameterName=parameter_name, value=add, lacing=Longest)
