# Dynamo graph DUPLICATE-VIEWS-AND-PLACE-IN-ONE-SHEET-DWG-EXPORT.dyn (Dynamo 2.6.1.8786)
# packages: Clockwork for Dynamo 2.x 2.3.0

code_block = CodeBlock { "XPXP"; "XP-01"; }
family_types = FamilyTypes("00-total-view:D 22 x 34 Horizontal")
categories = Categories("OST_Views")
all_elements_of_category = ElementsOfCategory(Category=categories)
boolean = BoolSelector(false)
clean = List.Clean(list=all_elements_of_category, preserveIndices=boolean)
code_block_2 = CodeBlock { "Selected"; }
getParameterValueByName = Element.GetParameterValueByName(element=clean, parameterName=code_block_2)
code_block_3 = CodeBlock { 1; }
eq = getParameterValueByName == code_block_3
filterByBoolMask = List.FilterByBoolMask(list=clean, mask=eq)
code_block_4 = CodeBlock { "Copy-"; }
code_block_5 = CodeBlock { "View Name"; }
getParameterValueByName_2 = Element.GetParameterValueByName(element=filterByBoolMask.in, parameterName=code_block_5)
add = code_block_4 + getParameterValueByName_2
duplicateWithDetailing = Custom[View.DuplicateWithDetailing](view=filterByBoolMask.in, name=add)  # package Clockwork for Dynamo 2.x; Duplicates a given view with detailing
byNameNumberTitleBlockAndViews = Sheet.ByNameNumberTitleBlockAndViews(sheetName=code_block.out0, sheetNumber=code_block.out1, titleBlockFamilyType=family_types, views=duplicateWithDetailing)
