# Dynamo graph DisallowWallJoint.dyn (Dynamo 2.6.1.8786)
# packages: WombatDynamo 1.3.2

element_types = ElementTypes("Wall")
all_elements_of_type = ElementsOfType(element_type=element_types)
boolean = BoolSelector(false)
allowDisallowJoins = WombatDynamo.Wall.AllowDisallowJoins(wall=all_elements_of_type, allow=boolean)
