# Dynamo graph SHEET-NAMING-NUMBERING-AUTO.dyn (Dynamo 2.6.1.8786)

# group: READ EXCEL DATA
file_path = Filename("E:\Design\Revit-Template\Dynamo\DrawingName-NumberAutomation\data.xlsx")
file_from_path = FileObject(path=file_path)
string = StringInput("AR_DRAWING_NUMBER")  # graph input
importExcel = Data.ImportExcel(file=file_from_path, sheetName=string)

# group: DATA REARRANGEMENT
transpose = List.Transpose(lists=importExcel)
code_block = CodeBlock { 0; 1; 2; }
getItemAtIndex = List.GetItemAtIndex(list=transpose, index=code_block.out1)
transpose_2 = List.Transpose(lists=importExcel)
getItemAtIndex_2 = List.GetItemAtIndex(list=transpose_2, index=code_block.out0)
transpose_3 = List.Transpose(lists=importExcel)
getItemAtIndex_3 = List.GetItemAtIndex(list=transpose_3, index=code_block.out2)

# group: CREATE SHEETS AND VIEWS
family_types = FamilyTypes("ARCHD 24x36 Horizontal-CNTNR-AR:D 22 x 34 Horizontal")  # graph input
byNameNumberTitleBlock = Sheet.ByNameNumberTitleBlock(sheetName=getItemAtIndex, sheetNumber=getItemAtIndex_2, titleBlockFamilyType=family_types)

# group: GROUP SHEET NAME AND NUMBER
code_block_2 = CodeBlock { "Sheet Set CNTNR"; }
setParameterByName = Element.SetParameterByName(element=byNameNumberTitleBlock, parameterName=code_block_2, value=getItemAtIndex_3)
