# Dynamo graph ExportPanelSchedulesToExcel.dyn (Dynamo 2.6.1.8786)
# packages: Data-Shapes 2021.2.91, bimorphNodes 3.0.3

name = Element.Name()  # unwired: element
code_block = CodeBlock { " Export schedule to excel"; }
file_path = Filename("E:\Logo\CNTNR-LOGO.jpg")
file_from_path = FileObject(path=file_path)
readFromFile = Image.ReadFromFile(file=file_from_path)
code_block_2 = CodeBlock { "Export"; }

# group: Excel File Location
code_block_3 = CodeBlock { "File Path"; "Browse"; }
filepath_data = Custom[FilePath Data](InputName=code_block_3.out0, DefaulPath=code_block_3.out1)  # package Data-Shapes; Create filepath input for UI.MultipleInputForm ++ . Check out www.data-shapes.net for more infos !

# group: Panel Schedule Data List
code_block_4 = CodeBlock { "List of Schedules"; }
element_types = ElementTypes("PanelScheduleView")
all_elements_of_type = ElementsOfType(element_type=element_types)
name_2 = FamilyType.Name(familyType=all_elements_of_type)
listview_data = Custom[Listview Data](InputName=code_block_4, Keys=all_elements_of_type, Values=name_2)  # package Data-Shapes; Create data for ListView input in UI.MultiInputForm ++ . Check out www.data-shapes.net for more infos.

list_create = List.Create(item0=filepath_data, item1=listview_data)
boolean = BoolSelector(true)
multipleinputform = Custom[MultipleInputForm ++](Description_optional=code_block, Logo_optional=readFromFile, ButtonText_optional=code_block_2, Inputs=list_create, Toggle=boolean)  # package Data-Shapes; Create a form with multiple inputs. see www.data-shapes.net for tutorials and infos!
code_block_5 = CodeBlock(lst=multipleinputform.User_Inputs) { lst[0]; lst[1]; }
string_from_object = FromObject(obj=code_block_5.out1)
code_block_6 = CodeBlock { 0; }
getData = Revit.Schedule.GetData(scheduleView=code_block_5.out1)
exportExcel = Data.ExportExcel(filePath=code_block_5.out0, sheetName=string_from_object, startRow=code_block_6, startCol=code_block_6, data=getData)
