# Dynamo graph L-Sp.dyn (Dynamo 2.6.1.8786)

family_types = FamilyTypes("Slab Edge-Thickened:24\" x 12\"")
family = FamilyType.Family(familyType=family_types)
python_script = Python(IN[0]=family)
# ---------- python_script.python (58 lines) ----------
import clr #This is .NET's Common Language Runtime. It's an execution environment
#that is able to execute code from several different languages.
import sys #sys is a fundamental Python library - here, we're using it to load in
#the standard IronPython libraries
sys.path.append('C:\Program Files (x86)\IronPython 2.7\Lib') #Imports the
#standard IronPython libraries, which cover everything from servers and
#encryption through to regular expressions.
import System #The System namespace at the root of .NET
from System import Array #.NET class for handling array information
from System.Collections.Generic import * #Lets you handle generics. Revit's API
#sometimes wants hard-typed 'generic' lists, called ILists. If you don't need
#these you can delete this line.
clr.AddReference('ProtoGeometry')  #A Dynamo library for its proxy geometry
#classes. You'll only need this if you're interacting with geometry.
from Autodesk.DesignScript.Geometry import * #Loads everything in Dynamo's
#geometry library
clr.AddReference("RevitNodes") #Dynamo's nodes for Revit
import Revit #Loads in the Revit namespace in RevitNodes
clr.ImportExtensions(Revit.Elements) #More loading of Dynamo's Revit libraries
clr.ImportExtensions(Revit.GeometryConversion) #More loading of Dynamo's
#Revit libraries. You'll only need this if you're interacting with geometry.
clr.AddReference("RevitServices") #Dynamo's classes for handling Revit documents
import RevitServices 
from RevitServices.Persistence import DocumentManager #An internal Dynamo class
#that keeps track of the document that Dynamo is currently attached to
from RevitServices.Transactions import TransactionManager #A Dynamo class for
#opening and closing transactions to change the Revit document's database

clr.AddReference("RevitAPI") #Adding reference to Revit's API DLLs
clr.AddReference("RevitAPIUI") #Adding reference to Revit's API DLLs

import Autodesk #Loads the Autodesk namespace
from Autodesk.Revit.DB import * #Loading Revit's API classes
from Autodesk.Revit.UI import * #Loading Revit's API UI classes  

doc = DocumentManager.Instance.CurrentDBDocument #Finally, setting up handles to the active Revit document
uiapp = DocumentManager.Instance.CurrentUIApplication #Setting a handle to the active Revit UI document
app = uiapp.Application  #Setting a handle to the currently-open instance of the Revit application
uidoc = uiapp.ActiveUIDocument #Setting a handle to the currently-open instance of the Revit UI application

family = UnwrapElement(IN[0])
family_type_ids = family.GetFamilySymbolIds()

family_instances = []

for family_type_id in family_type_ids:
	family_instance_filter = FamilyInstanceFilter(doc, family_type_id)
	elements = FilteredElementCollector(doc).WherePasses(family_instance_filter).ToElements()
	family_instances.append(elements)

OUT = family_instances
task_dialog = TaskDialog("Example Title")
task_dialog.CommonButtons = TaskDialogCommonButtons.Cancel | TaskDialogCommonButtons.Ok | TaskDialogCommonButtons.Close |     TaskDialogCommonButtons.No | TaskDialogCommonButtons.Yes | TaskDialogCommonButtons.Retry | TaskDialogCommonButtons.None
task_dialog.FooterText = "Example Footer Text"
task_dialog.MainInstruction = "Example Main Instruction"
task_dialog.MainContent = "This is the main content for this TaskDialog"

task_dialog.Show()
# ----------------------------------------
watch = Watch(python_script)
code_block = CodeBlock { 1; 4; 5; }
byCoordinates = Point.ByCoordinates(x=code_block.out2, y=code_block.out1, z=code_block.out0)
byCoordinates_2 = Point.ByCoordinates(x=code_block.out0, y=code_block.out1, z=code_block.out2)
byStartPointEndPoint = Line.ByStartPointEndPoint(startPoint=byCoordinates, endPoint=byCoordinates_2)
select_model_element = DSModelElementSelection()  # 1 picked in the model
