# Dynamo graph READ-WRITE-A-PARAMETER.dyn (Dynamo 2.6.1.8786)

# group: GET ALL TITLE BLOCKS
categories = Categories("OST_TitleBlocks")
all_elements_of_category = ElementsOfCategory(Category=categories)

# group: CHECK PARAMETER VALUES
code_block = CodeBlock { "Drawn By"; "Checked By"; }
getParameterValueByName = Element.GetParameterValueByName(element=all_elements_of_category, parameterName=code_block.out0)
getParameterValueByName_2 = Element.GetParameterValueByName(element=all_elements_of_category, parameterName=code_block.out1)

# group: WRITE PARAMETER VALUES
code_block_2 = CodeBlock { "BT"; "DD"; }
setParameterByName = Element.SetParameterByName(element=all_elements_of_category, parameterName=code_block.out0, value=code_block_2.out0)
setParameterByName_2 = Element.SetParameterByName(element=all_elements_of_category, parameterName=code_block.out1, value=code_block_2.out1)

# group: GET ALL TITLE BLOCKS
categories_2 = Categories("OST_TitleBlocks")
all_elements_of_category_2 = ElementsOfCategory(Category=categories_2)

# group: UPPERCASE STRINGS
code_block_3 = CodeBlock { "Sheet Name"; }
getParameterValueByName_3 = Element.GetParameterValueByName(element=all_elements_of_category_2, parameterName=code_block_3)
toUpper = String.ToUpper(str=getParameterValueByName_3)

# group: WRITE DATA
setParameterByName_3 = Element.SetParameterByName(element=all_elements_of_category_2, parameterName=code_block_3, value=toUpper)
