# Dynamo graph Re-number-Sheet-Numbers.dyn (Dynamo 2.6.1.8786)

# group: SHEET ARRANGEMENT
categories = Categories("OST_Sheets")
all_elements_of_category = ElementsOfCategory(Category=categories)
code_block = CodeBlock { 0; 23; 1; }
slice = List.Slice(list=all_elements_of_category, start=code_block.out0, end=code_block.out1, step=code_block.out2)

# group: SHEET NUMBER SEQUENCE
code_block_2 = CodeBlock { 1; 1; }
count = List.Count(list=slice)
add = code_block_2.out0 + count
range = Range(start=code_block_2.out0, end=add, step=code_block_2.out1)

# group: SHEET PREFIX
string_from_object = FromObject(obj=range)
code_block_3 = CodeBlock { 0; "SD"; }
insert = String.Insert(str=string_from_object, index=code_block_3.out0, toInsert=code_block_3.out1)

# group: UPDATE SHEET NUMBERS
code_block_4 = CodeBlock { "Sheet Number"; }
setParameterByName = Element.SetParameterByName(element=slice, parameterName=code_block_4, value=insert)

code_block_5 = CodeBlock { 2; "00"; }
insert_2 = String.Insert(str=insert, index=code_block_5.out0, toInsert=code_block_5.out1)
watch = Watch(insert_2)
