# Dynamo graph LearningSpace.dyn (Dynamo 2.6.1.8786)

code_block = CodeBlock { "ABC"; "CVB"; "AAA"; }
python_script = Python(IN[0]=code_block.out0, IN[1]=code_block.out1, IN[2]=code_block.out2)
# ---------- python_script.python (9 lines) ----------
#VARIABLE INPUTS
DOG = IN[0]
CAT = IN[1]
FISH = IN[2]
A = "_"

Z = DOG + A + CAT + A + FISH

OUT = Z
# ----------------------------------------
python_script_2 = Python()  # unwired: IN[0]
# ---------- python_script_2.python (16 lines) ----------
# Load the Python Standard and DesignScript Libraries
import sys
import clr
clr.AddReference('ProtoGeometry')
from Autodesk.DesignScript.Geometry import *

# The inputs to this node will be stored as a list in the IN variables.
outList = []

for r in clr.References:
	outList.append(r)

# Place your code below this line

# Assign your output to the OUT variable.
OUT = outList
# ----------------------------------------
boiler_plate_py = Python()  # unwired: IN[0]
# ---------- boiler_plate_py.python (43 lines) ----------
# Load the Python Standard and DesignScript Libraries
import sys
import clr
clr.AddReference('ProtoGeometry')
from Autodesk.DesignScript.Geometry import *

pyt_path = r'C:\Program Files (x86)\IronPython 2.7\Lib'
sys.path.append(pyt_path)

import os

import System

import System.Collections

clr.AddReference("RevitServices")
import RevitServices

from RevitServices.Persistence import DocumentManager
doc = DocumentManager.Instance.CurrentDBDocument
uidoc = DocumentManager.Instance.CurrentUIDocument
app = DocumentManager.Instance.CurrentUIApplication.Application

from RevitServices.Transactions import TransactionManager

clr.AddReference("RevitNodes")
import Revit
clr.ImportExtensions(Revit.Elements)
clr.ImportExtensions(Revit.GeometryConversion)

clr.AddReference("RevitAPI")
from Autodesk.Revit.DB import *

clr.AddReference("RevitAPIUI")
from Autodesk.Revit.UI import*

# The inputs to this node will be stored as a list in the IN variables.
dataEnteringNode = IN

# Place your code below this line

# Assign your output to the OUT variable.
OUT = 0
# ----------------------------------------
