# Dynamo graph Rotate PipeFitting - RVT2018 - WORKING.dyn (Dynamo 1.3.1.1736)

code_block = CodeBlock { 45; }  # frozen
# note: Fitting
select_pipe_fitting = DSModelElementSelection()
# note: Pipe
select_pipe_attached_to_ftg = DSModelElementSelection()
number_slider = DoubleSlider(26.4, range=0..100 step 0.1)
python_script = Python(IN[0]=select_pipe_fitting, IN[1]=select_pipe_attached_to_ftg, IN[2]=number_slider)
# ---------- python_script.python (61 lines) ----------
import clr
clr.AddReference("RevitAPI")
import Autodesk
from Autodesk.Revit.DB import *

clr.AddReference('ProtoGeometry')
from Autodesk.DesignScript.Geometry import *

clr.AddReference("RevitNodes")
import Revit

clr.ImportExtensions(Revit.Elements)

clr.AddReference("RevitServices")
import RevitServices
from RevitServices.Persistence import DocumentManager
from RevitServices.Transactions import TransactionManager

from System.Collections.Generic import *
import math

doc = DocumentManager.Instance.CurrentDBDocument

clr.ImportExtensions(Revit.GeometryConversion)

inn = [UnwrapElement(IN[0]),UnwrapElement(IN[1])]
conns = [0,1]

def disconnect(curve):
	connectors = curve.ConnectorManager.Connectors
	for conn in connectors:
		if conn.IsConnected:
			for c in conn.AllRefs:
				if conn.IsConnectedTo(c):
					conns[0] = conn
					conns[1] = c
					conn.DisconnectFrom(c)

angle = (IN[2]*math.pi)/180
TransactionManager.Instance.EnsureInTransaction(doc)


connectors = inn[0].MEPModel.ConnectorManager.Connectors
for c in connectors:
	if c.GetMEPConnectorInfo().IsPrimary:
		primary = c
		break
	primary = c
loc = inn[0].Location
ductloc = inn[1].Location
center = primary.CoordinateSystem.BasisZ
centerrot = XYZ(center.X,center.Y,center.Z)
line = Autodesk.Revit.DB.Line.CreateUnbound(primary.Origin,center)
disconnect(inn[1])
ductloc.Rotate(line,angle)
loc.Rotate(line,angle)
conns[0].ConnectTo(conns[1])

TransactionManager.Instance.TransactionTaskDone()

OUT =  IN[0]
# ----------------------------------------
