# Dynamo graph RotateFitting&Branch_Custom Angle.dyn (Dynamo 1.2.1.3083)

pick_model_element = Custom[Pick Model Element]()  # This offers a single selection of a model element. Created for Dynamo Player usage.
pick_model_element_2 = Custom[Pick Model Element]()
textBoxInput = Custom[Rhythm.TextBoxInput]()  # Provides a text box input for users. Allows for multiple strings if needed.
toNumber = String.ToNumber(textBoxInput)
python_script = Python(IN[0]=pick_model_element, IN[1]=pick_model_element_2, IN[2]=toNumber)
# ---------- python_script.python (61 lines) ----------
import clr
clr.AddReference("RevitAPI")
import Autodesk
from Autodesk.Revit.DB import *

clr.AddReference('ProtoGeometry')
from Autodesk.DesignScript.Geometry import *

clr.AddReference("RevitNodes")
import Revit

clr.ImportExtensions(Revit.Elements)

clr.AddReference("RevitServices")
import RevitServices
from RevitServices.Persistence import DocumentManager
from RevitServices.Transactions import TransactionManager

from System.Collections.Generic import *
import math

doc = DocumentManager.Instance.CurrentDBDocument

clr.ImportExtensions(Revit.GeometryConversion)

inn = [UnwrapElement(IN[0]),UnwrapElement(IN[1])]
conns = [0,1]

def disconnect(curve):
	connectors = curve.ConnectorManager.Connectors
	for conn in connectors:
		if conn.IsConnected:
			for c in conn.AllRefs:
				if conn.IsConnectedTo(c):
					conns[0] = conn
					conns[1] = c
					conn.DisconnectFrom(c)

angle = (IN[2]*math.pi)/180
TransactionManager.Instance.EnsureInTransaction(doc)


connectors = inn[0].MEPModel.ConnectorManager.Connectors
for c in connectors:
	if c.GetMEPConnectorInfo().IsPrimary:
		primary = c
		break
	primary = c
loc = inn[0].Location
ductloc = inn[1].Location
center = primary.CoordinateSystem.BasisZ
centerrot = XYZ(center.X,center.Y,center.Z)
line = Autodesk.Revit.DB.Line.CreateUnbound(primary.Origin,center)
disconnect(inn[1])
ductloc.Rotate(line,angle)
loc.Rotate(line,angle)
conns[0].ConnectTo(conns[1])

TransactionManager.Instance.TransactionTaskDone()

OUT =  IN[0]
# ----------------------------------------
