# Dynamo graph SCHEDULE-TO-EXCEL.dyn (Dynamo 2.6.1.8786)
# packages: bimorphNodes 3.0.3

# group: GET ALL REVIT SCHEDULES
element_types = ElementTypes("ViewSchedule")
all_elements_of_type = ElementsOfType(element_type=element_types)

# group: FILTER WANTED SCHEDULES
name = Element.Name(element=all_elements_of_type)
code_block = CodeBlock { "PIPE"; }
startsWith = String.StartsWith(str=name, searchFor=code_block)
filterByBoolMask = List.FilterByBoolMask(list=all_elements_of_type, mask=startsWith)

# group: WANTED NAMES OF SCHEDULE
filterByBoolMask_2 = List.FilterByBoolMask(list=name, mask=startsWith)

# group: GET DATA-BIMORPH
getData = Revit.Schedule.GetData(scheduleView=filterByBoolMask.in)

# group: WRITE DATA TO EXCEL
file_path = Filename("C:\Users\Owner\Desktop\ABC.xlsx")
code_block_2 = CodeBlock { 0; TRUE; }  # unwired: TRUE
exportExcel = Data.ExportExcel(filePath=file_path, sheetName=filterByBoolMask_2.in, startRow=code_block_2.out0, startCol=code_block_2.out0, data=getData)
