# Dynamo graph SheetNumberingAutomation.dyn (Dynamo 2.6.1.8786)

# group: Sheet X of X.dyn Ver: 1.0
categories = Categories("OST_Sheets")  # graph input
all_elements_of_category = ElementsOfCategory(Category=categories)
code_block = CodeBlock { "Sheet Number"; }
getParameterValueByName = Element.GetParameterValueByName(element=all_elements_of_category, parameterName=code_block)
sortByKey = List.SortByKey(list=all_elements_of_category, keys=getParameterValueByName)
flatten = List.Flatten(list=sortByKey.sorted_list)
string = StringInput("T-Total Sheet")  # graph input
count = List.Count(list=flatten)
string_from_object = FromObject(obj=count)
setParameterByName = Element.SetParameterByName(element=flatten, parameterName=string, value=string_from_object)
string_2 = StringInput("T-Sheet Number")  # graph input
number = DoubleInput(1)  # graph input
sequence = Sequence(start=number, amount=count)
string_from_object_2 = FromObject(obj=sequence)
setParameterByName_2 = Element.SetParameterByName(element=flatten, parameterName=string_2, value=string_from_object_2)
