# Dynamo graph UpperCase-Schedule-Parameter.dyn (Dynamo 2.6.1.8786)

# group: UPPERCASE CONTENT
categories = Categories("OST_Doors")
all_elements_of_category = ElementsOfCategory(Category=categories)
elementType = Element.ElementType(element=all_elements_of_category)
code_block = CodeBlock { "Lockset"; "Finish"; "Description"; }
getParameterValueByName = Element.GetParameterValueByName(element=elementType, parameterName=code_block.out2)
toLower = String.ToLower(str=getParameterValueByName)
setParameterByName = Element.SetParameterByName(element=elementType, parameterName=code_block.out2, value=toLower)
views = Views("HARDWARE SCHEDULE")
python_script = Python(IN[0]=views)
# ---------- python_script.python (42 lines) ----------
import clr

clr.AddReference('RevitAPI')
from Autodesk.Revit.DB import *
from Autodesk.Revit.DB.Structure import *

clr.AddReference('RevitAPIUI')
from Autodesk.Revit.UI import *

clr.AddReference('System')
from System.Collections.Generic import List

clr.AddReference('RevitNodes')
import Revit
clr.ImportExtensions(Revit.GeometryConversion)
clr.ImportExtensions(Revit.Elements)

clr.AddReference('RevitServices')
import RevitServices
from RevitServices.Persistence import DocumentManager
from RevitServices.Transactions import TransactionManager

doc = DocumentManager.Instance.CurrentDBDocument
uidoc=DocumentManager.Instance.CurrentUIApplication.ActiveUIDocument

#Preparing input from dynamo to revit
viewSchedule = UnwrapElement(IN[0])

#Do some action in a Transaction
TransactionManager.Instance.EnsureInTransaction(doc)

elements = FilteredElementCollector(doc, viewSchedule.Id).ToElements()

params = []
names = []
for i in elements:
    params.append(i.Parameters)
    names.append(i.Name)

TransactionManager.Instance.TransactionTaskDone()

OUT = elements, names
# ----------------------------------------
