# Dynamo graph WRITE AND READ EXCEL DATA TO REVIT (IN-PROGRESS).dyn (Dynamo 2.10.1.3976)

# group: GET VALUE FROM PARAMETERS
categories = Categories("OST_Walls")
all_elements_of_category = ElementsOfCategory(Category=categories)
getMaterials = Element.GetMaterials(element=all_elements_of_category)
flatten = List.Flatten(list=getMaterials)
uniqueItems = List.UniqueItems(list=flatten)
id = Element.Id(element=uniqueItems)
name = Material.Name(material=uniqueItems)
code_block = CodeBlock { "Description"; "Comments"; }
getParameterValueByName = Element.GetParameterValueByName(element=uniqueItems, parameterName=code_block.out0)
getParameterValueByName_2 = Element.GetParameterValueByName(element=uniqueItems, parameterName=code_block.out1)
list_create = List.Create(item0=id, item1=name, item2=getParameterValueByName, item3=getParameterValueByName_2)

# group: WRITE TO EXCEL
file_path = Filename("C:\Users\Owner\Desktop\ABC.xlsx")
code_block_2 = CodeBlock { "Sheet1"; }
code_block_3 = CodeBlock { 0; true; }
transpose = List.Transpose(lists=list_create)
exportExcel = Data.ExportExcel(filePath=file_path, sheetName=code_block_2, startRow=code_block_3.out0, startCol=code_block_3.out0, data=transpose, overWrite=code_block_3.out1)

# group: READ FROM EXCEL
file_from_path = FileObject(path=file_path)
importExcel = Data.ImportExcel(file=file_from_path, sheetName=code_block_2)

# group: WRITE DATA BACK TO REVIT
code_block_4 = CodeBlock { "Comments"; }
transpose_2 = List.Transpose(lists=importExcel)
code_block_5 = CodeBlock { 2; }
getItemAtIndex = List.GetItemAtIndex(list=transpose_2, index=code_block_5)
setParameterByName = Element.SetParameterByName(element=uniqueItems, parameterName=code_block_4, value=getItemAtIndex)
